# Dynamo graph Execute_visualizeSelection.dyn (Dynamo 2.12.0.5650)

# group: Tune the graphics style.
rerunnodes = Python()  # CPython3; unwired: IN[0]
# ---------- rerunnodes.python (83 lines) ----------
###############################################################
# Import general packages.
import clr
import sys
import math
import System
import io
import os
import importlib

# Import Revit/Dynamo API related packages.
clr.AddReference('DynamoRevitDS')
import Dynamo
from System import Array
from System.Collections.Generic import *
clr.AddReference("RevitNodes")
import Revit
clr.ImportExtensions(Revit.Elements)
clr.ImportExtensions(Revit.GeometryConversion)
clr.AddReference("RevitServices")
import RevitServices
from RevitServices.Persistence import DocumentManager 
from RevitServices.Transactions import TransactionManager 
clr.AddReference("RevitAPI")
clr.AddReference('ProtoGeometry')
import Autodesk 
from Autodesk.DesignScript.Geometry import *
from Autodesk.DesignScript import *
from Autodesk.Revit.DB import *
from Autodesk.Revit.DB import Parameter
from Autodesk.Revit.DB.Architecture import *
from Autodesk.Revit.DB import IFailuresPreprocessor

# Import external python packages.
localapp = os.getenv(r'LOCALAPPDATA')
sys.path.append(os.path.join(localapp, r'python-3.8.3-embed-amd64\Lib\site-packages'))

# Import customized python packgaes.
sys.path.append(r'C:\dev\phd\jw\healing\src\godyn')

import healBasics
importlib.reload(healBasics)
import healChecks
importlib.reload(healChecks)
import healParameters
importlib.reload(healParameters)

###############################################################
doc = DocumentManager.Instance.CurrentDBDocument


###############################################################
# Temporary functions


###############################################################
# Prepare the input (of the Python Node)
element = IN[0]


##############################################################
# Prepare the output (of the Python Node)
out = []


###############################################################
# Start Transaction in Revit
TransactionManager.Instance.EnsureInTransaction(doc)


###############################################################
# Main part
healBasics.rerunNodes()


###############################################################
# End Transaction in Revit
TransactionManager.Instance.TransactionTaskDone()


###############################################################
# End
OUT = out
# ----------------------------------------
current = Document.Current()  # frozen
activeView = Document.ActiveView(document=current)
setGraphicsStyle = Python(IN[0]=activeView)  # CPython3
# ---------- setGraphicsStyle.python (83 lines) ----------
###############################################################
# Import general packages.
import clr
import sys
import math
import System
import io
import os
import importlib

# Import Revit/Dynamo API related packages.
clr.AddReference('DynamoRevitDS')
import Dynamo
from System import Array
from System.Collections.Generic import *
clr.AddReference("RevitNodes")
import Revit
clr.ImportExtensions(Revit.Elements)
clr.ImportExtensions(Revit.GeometryConversion)
clr.AddReference("RevitServices")
import RevitServices
from RevitServices.Persistence import DocumentManager 
from RevitServices.Transactions import TransactionManager 
clr.AddReference("RevitAPI")
clr.AddReference('ProtoGeometry')
import Autodesk 
from Autodesk.DesignScript.Geometry import *
from Autodesk.DesignScript import *
from Autodesk.Revit.DB import *
from Autodesk.Revit.DB import Parameter
from Autodesk.Revit.DB.Architecture import *
from Autodesk.Revit.DB import IFailuresPreprocessor

# Import external python packages.
localapp = os.getenv(r'LOCALAPPDATA')
sys.path.append(os.path.join(localapp, r'python-3.8.3-embed-amd64\Lib\site-packages'))

# Import customized python packgaes.
sys.path.append(r'C:\dev\phd\jw\healing\src\godyn')

import healBasics
importlib.reload(healBasics)
import healChecks
importlib.reload(healChecks)
import healParameters
importlib.reload(healParameters)
import healVisual
importlib.reload(healVisual)

###############################################################
doc = DocumentManager.Instance.CurrentDBDocument


###############################################################
# Temporary functions


###############################################################
# Prepare the input (of the Python Node)
elements = UnwrapElement(IN[0])

##############################################################
# Prepare the output (of the Python Node)
out = []

###############################################################
# Start Transaction in Revit
TransactionManager.Instance.EnsureInTransaction(doc)


###############################################################
# Main part
out = healVisual.setGraphicsStyle(elements)


###############################################################
# End Transaction in Revit
TransactionManager.Instance.TransactionTaskDone()


###############################################################
# End
OUT = out
# ----------------------------------------

string = StringInput("C:\dev\phd\ModelHealer\ini\topo\k3\res_ini_perrule_failure.csv")
string_2 = StringInput("C:\dev\phd\ModelHealer\ini\topo\k3\res_ini_perrule_failureneighbor.csv")
string_3 = StringInput("IBC1020_2")
string_4 = StringInput("IBC1207_1")
string_5 = StringInput("IBC1207_3")
list_create = List.Create(item0=string_3, item1=string_4, item2=string_5)
visualizeSelection = Custom[visualizeSelection](CSVPathFailure=string, CSVPathFailureNeighbors=string_2, IBCRulesAsString=list_create, lacing=Longest)  # visualize the selected elements.
